# Grasshopper definition ColorGroups.gh (Grasshopper 1.0.7)
# Copyright: 2021

# ---- group: stuff
# Other stuff to add:
# - Event based changing wires between groups?
# - Event based add components without a group to the visual group behind them
button = Button()
authornames = CSharpScript(SetNameToWindowsName=Button(), ResetName=button)  # -> out; inputs SetNameToWindowsName: Boolean, ResetName: Boolean
# ---------- authornames: C# ----------
    if(SetNameToWindowsName)
    {
      if (string.Equals(Grasshopper.CentralSettings.AuthorName, Environment.UserName, StringComparison.InvariantCulture))
      {

        msg = "Didn't change author name, as it was already set to " + Environment.UserName;
      }
      else
      {
        oldName = Grasshopper.CentralSettings.AuthorName;
        Grasshopper.CentralSettings.AuthorName = Environment.UserName;
        msg = "Changed author name to " + Environment.UserName + "\nThe old name was " + oldName;
      }
    }

    if (ResetName && !String.IsNullOrEmpty(oldName))
    {
      Grasshopper.CentralSettings.AuthorName = oldName;
      msg = "Reset author name to " + oldName;
    }

    Print(msg);
# ---------- authornames: C# additional code ----------
  string oldName = string.Empty;
  string msg = string.Empty;
# ---------- end authornames ----------
panel = Panel(authornames)

# ----
# WIP: Making a version to set all wires between different groups to faint.
fixwires = CSharpScript()  # -> out; inputs FixOnce: Boolean, Enable: Boolean
# ---------- fixwires: C# usings ----------
using System.Text;
using System.Linq;
using Grasshopper.Kernel.Special;
# ---------- fixwires: C# ----------
    SetDictionary();
# ---------- fixwires: C# additional code ----------
  public Dictionary<IGH_DocumentObject, HashSet<GH_Group>> groupsPerObject = new Dictionary<IGH_DocumentObject, HashSet<GH_Group>>();
  //public HashSet<Guid> hashSet = new HashSet<Guid>();
  public void SetDictionary()
  {
    IList<IGH_DocumentObject> objects = Grasshopper.Instances.ActiveCanvas.Document.Objects;

    groupsPerObject = objects
      .Where(o => o.GetType() != typeof(GH_Group))
      .ToDictionary(o => o, o => new HashSet<GH_Group>());

    foreach(GH_Group grp in objects.OfType<GH_Group>())
    {
      foreach(IGH_DocumentObject obj in grp.ObjectsRecursive().Where(o => o.GetType() != typeof(GH_Group)))
      {
        groupsPerObject[obj].Add(grp);
      }
    }




  }

  public bool HasGroupsInCommon(IGH_DocumentObject obj1, IGH_DocumentObject obj2)
  {
    HashSet<GH_Group> set1 = groupsPerObject[obj1];
    HashSet<GH_Group> set2 = groupsPerObject[obj2];

    set1.IntersectWith(set2);

    return set1.Any();
  }
# ---------- end fixwires ----------

geo_geometry = ColourSwatch(SwatchColor=RGBA(34, 128, 34, 150))
out_outputs = ColourSwatch(SwatchColor=RGBA(255, 144, 54, 150))
debug = BooleanToggle(False)
g_general = ColourSwatch(SwatchColor=RGBA(217, 217, 217, 150))
# Automatically color groups based on prefix
# By Mathias Sønderskov Schaltz 2022
i_inputs = ColourSwatch(SwatchColor=RGBA(255, 231, 54, 150))

# ----
# Do not modify this
# component without setting
# enable to false first!
colorgroups = CSharpScript(Colors=[i_inputs, out_outputs, g_general, geo_geometry], Enable=Toggle(True), debug=debug)  # -> out; inputs Colors: list of Color, Enable: Boolean, debug: Boolean
# ---------- colorgroups: C# usings ----------
using System.Linq;
using System.Text;
# ---------- colorgroups: C# ----------
    msg.Clear();
    msg.AppendFormat("Set up events on ID {0}\n", id);
    this.Component.Message = "id: " + id.ToString();

    _debug = debug; //Set to true to have all events printed in rhino log

    if (Enable)
    {
      SetupDict(); // Create a dictionary of the input swatches
      SetEventHandlers(); // This would do the job.

      foreach(Grasshopper.Kernel.Special.GH_Group grp in GrasshopperDocument.Objects.OfType<Grasshopper.Kernel.Special.GH_Group>())
      {
        //ColorGroup(grp, null); // You decide if it should run once on all existing groups
      }
    }
    else
    {
      RemoveEventHandlers();
    }

    Print(msg.ToString());


    // Component setup
    Component.Description = "Set up event handlers to color groups based on prefixes such as 'in_' and 'out_'.\n"
      + "Please insert only swatcheds directly into the Colors input\n\n"
      + "MIT License. Copyright Mathias Sønderskov Schaltz 2022";
    Component.Params.Input[0].Description = "Please insert only swatcheds directly into the Colors input.\nRemember to rename them";
    Component.Params.Input[1].Description = "Toggle to run...";
    Component.Params.Input[2].Description = "Set debug to true to get all the events printed in the rhino log";
# ---------- colorgroups: C# additional code ----------
  int id = 0;
  Dictionary<string, System.Drawing.Color> colorDict = new Dictionary<string, System.Drawing.Color>();
  StringBuilder msg = new StringBuilder();
  bool _debug = false;


  public void SetupDict()
  {
    colorDict.Clear();
    // Get all inputs to "Colors"
    IList<IGH_Param> colorSources = this.Component.Params.Input[0].Sources;
    if (colorSources.Count == 0)
    {
      throw new Exception("You forgot to setup the colors. Please input swatch components and rename them");
    }
    foreach(IGH_Param source in colorSources)
    {
      //if (source.Type.ToString() == "Grasshopper.Kernel.Types.GH_Colour")
      if (source is Grasshopper.Kernel.Special.GH_ColourSwatch)
      {
        string nickName = source.NickName.Split('_')[0].Trim() + '_';
        if(!colorDict.ContainsKey(nickName))
        {
          Grasshopper.Kernel.Special.GH_ColourSwatch swatch = (Grasshopper.Kernel.Special.GH_ColourSwatch) source;
          colorDict.Add(nickName, swatch.SwatchColour);
        }
        else
        {
          throw new Exception("Multiple swatches using the same name detected. Please rename");
        }
      }
      else
      {
        throw new Exception("Whacko! Why did you input a non-swatch into the Colors? " + source.Type.ToString());
      }

    }

    msg.AppendFormat("Set up the dictionaries with {0} colors\n", colorDict.Count);
    foreach(var pairs in colorDict)
    {
      msg.AppendFormat("{0} -> {1}\n", ("\"" + pairs.Key + "\"").PadRight(5 + colorDict.Keys.Select(k => k.Length).Max()), pairs.Value);
    }
  }

  public void SetEventHandlers()
  {

    // Always remove events first to avoid duplicates
    GrasshopperDocument.ObjectsAdded -= OnObjectsAdded;
    GrasshopperDocument.ObjectsDeleted -= OnObjectsRemoved;
    GrasshopperDocument.ObjectsDeleted -= DeleteThisComponent;

    // Attach events
    GrasshopperDocument.ObjectsAdded += OnObjectsAdded;
    GrasshopperDocument.ObjectsDeleted += OnObjectsRemoved;
    GrasshopperDocument.ObjectsDeleted += DeleteThisComponent;


    foreach(Grasshopper.Kernel.Special.GH_Group grp in GrasshopperDocument.Objects.OfType<Grasshopper.Kernel.Special.GH_Group>())
    {
      grp.ObjectChanged -= ColorGroup;
      grp.ObjectChanged += ColorGroup;

      ColorGroup(grp, null); // Make sure to run it once
    }
    msg.AppendFormat("Added the eventhandlers on {0} existing groups and on future created groups", GrasshopperDocument.Objects.OfType<Grasshopper.Kernel.Special.GH_Group>().Count());
  }

  public void OnObjectsAdded(object sender, GH_DocObjectEventArgs e)
  {
    bool any = false;
    foreach (Grasshopper.Kernel.Special.GH_Group grp in e.Objects.OfType<Grasshopper.Kernel.Special.GH_Group>())
    {
      grp.ObjectChanged -= ColorGroup;
      grp.ObjectChanged += ColorGroup;
      any = true;
    }

    DebugWrite(any ? "Group Objects Added: Attaching Events to ObjectChanged" : "Objects Added - but no groups");
  }

  //Same but reversed
  public void OnObjectsRemoved(object sender, GH_DocObjectEventArgs e)
  {
    bool any = false;
    foreach (Grasshopper.Kernel.Special.GH_Group grp in e.Objects.OfType<Grasshopper.Kernel.Special.GH_Group>())
    {
      grp.ObjectChanged -= ColorGroup;
      any = true;
    }

    DebugWrite(any ? "Group Objects Removed, removing event" : "Objects Removed - although not a group");

  }



  public void RemoveEventHandlers()
  {
    GrasshopperDocument.ObjectsAdded -= OnObjectsAdded;
    GrasshopperDocument.ObjectsDeleted -= OnObjectsRemoved;


    foreach(Grasshopper.Kernel.Special.GH_Group grp in GrasshopperDocument.Objects.OfType<Grasshopper.Kernel.Special.GH_Group>())
    {
      grp.ObjectChanged -= ColorGroup;

    }
    msg.AppendFormat("Removed event handlers on document and on {0} groups\n", GrasshopperDocument.Objects.OfType<Grasshopper.Kernel.Special.GH_Group>().Count());

  }

  public void ColorGroup(object sender, EventArgs e)
  {

    Grasshopper.Kernel.Special.GH_Group grp = sender as Grasshopper.Kernel.Special.GH_Group;
    if (grp == null) return; //not type GH_Group
    //if (!grp.NickName.EndsWith("_")) return;


    string prefix = grp.NickName.Split('_')[0].Trim() + '_';

    string prefixes = String.Join(", ", colorDict.Keys.Select(k => "\"" + k + "\""));


    if (colorDict.ContainsKey(prefix))
    {
      if (grp.NickName.EndsWith("_"))
        grp.Colour = colorDict[prefix];
      grp.NickName = grp.NickName.Replace(prefix, "");

      DebugWrite("Colored " + grp.NickName);

    }
    else
    {
      //DebugWrite("Group changed but not relevant: prefix " + prefix + " is not among " + prefixes);
    }

  }
  public void DebugWrite(string msg)
  {
    if (_debug)
    {
      Rhino.RhinoApp.WriteLine(String.Format("[ColGrps {0}]: {1}", id, msg));
    }
  }

  public void DeleteThisComponent(object sender, GH_DocObjectEventArgs e)
  {

    if (e.Objects.OfType<Grasshopper.Kernel.GH_Component>().Where(o => o.NickName == this.Component.NickName).Any())
    {
      DebugWrite("Removed template component. Removing all the eventhandlers");
      RemoveEventHandlers();
    }


  }
# ---------- end colorgroups ----------

panel_2 = Panel(colorgroups)
